# Grasshopper definition volcano_final_recent.gh (Grasshopper 1.0.8)

surface = Surface(<surface referenced from the Rhino model>)
curve = Curve(<curve referenced from the Rhino model>)
populate_2d = Populate2D(Region=surface, Count=Slider(100, range=0..100), Seed=Slider(5, range=0..10))
pull_point = PullPoint(Point=populate_2d, Geometry=curve, ClosestOnly=True)  # -> ClosestPoint, flatten(Distance)
voronoi = Voronoi(Points=populate_2d, Boundary=surface, BruteForceOverride=False)
area = Area(Geometry=voronoi)  # -> Area, Centroid
bounds = Bounds(Numbers=pull_point.Distance)
construct_domain = ConstructDomain(DomainStart=Slider(0.47, range=0..1), DomainEnd=Slider(1, range=0..1))
remap_numbers = RemapNumbers(Value=pull_point.Distance, Source=bounds, Target=construct_domain)  # -> Mapped, Clipped
bounds_2 = Bounds(Numbers=pull_point.Distance)
construct_domain_2 = ConstructDomain(DomainStart=Slider(0.25, range=0..1), DomainEnd=Slider(15, range=0..100))
scale = Scale(Geometry=voronoi, Center=area.Centroid, Factor=remap_numbers.Mapped)  # -> Geometry, Transform
merge = Merge(Data1=voronoi, Data2=scale.Geometry)
remap_numbers_2 = RemapNumbers(Value=pull_point.Distance, Source=bounds_2, Target=construct_domain_2)  # -> Mapped, Clipped
boundary_surfaces = BoundarySurfaces(Edges=merge, UseTasks=True)
unit_z = UnitZ(Factor=remap_numbers_2.Mapped)
extrude = Extrude(Base=boundary_surfaces, Direction=unit_z)
custom_preview = CustomPreview(
    Geometry=extrude,
    Material={diffuse=RGB(228, 178, 227), emission=RGB(68, 53, 68), shine=0.5, specular=RGB(255, 254, 254), transparency=0})
